# Grasshopper definition Code_V2.1.gh (Grasshopper 1.0.7)
# plug-ins: LadybugGrasshopper

python = GhPythonScript(start="1", end="7")  # -> Nums; inputs start: Int32, end: Int32
# ---------- python: Python ----------
__author__ = "ccy"
__version__ = "2022.09.02"

curr = start
Nums = []
for i in range(end - start + 1):
    Nums.append(curr)
    curr += 1
# ---------- end python ----------
python_2 = GhPythonScript()  # -> Reflects, Refracts; disabled
# ---------- python_2: Python ----------
__author__ = "ccy"
__version__ = "2022.11.16"

from math import radians

Angs = []
for i in range(91):
    Angs.append(radians(i))

Reflects = []
Refracts = []
for ang in Angs:
    [refl, refr] = material.reflect(ang)
    Reflects.append(refl)
    Refracts.append(refr)
# ---------- end python_2 ----------
tau_b = Panel("""0.342
0.363
0.397
0.423
0.430
0.425
0.433
0.423
0.400
0.377
0.354
0.338""")
python_3 = GhPythonScript(start="1", end="24", step="0.5")  # -> Nums; inputs start: Int32, end: Int32
# ---------- python_3: Python ----------
__author__ = "ccy"
__version__ = "2022.09.02"

from math import floor

curr = start
Nums = []
for i in range(int((end - start)/step + 1)):
    Nums.append(curr)
    curr += step
# ---------- end python_3 ----------
python_4 = GhPythonScript(start="1", end="31", step="10")  # -> Nums; inputs start: Int32, end: Int32, step: Int32
# ---------- python_4: Python ----------
__author__ = "ccy"
__version__ = "2022.09.02"

from math import floor

curr = start
Nums = []
for i in range(int(floor((end - start + 1)/step))):
    Nums.append(curr)
    curr += step
# ---------- end python_4 ----------
python_5 = GhPythonScript(Nums=python, num="12")  # -> Nums; inputs Nums: list of Int32, num: Int32
# ---------- python_5: Python ----------
__author__ = "ccy"
__version__ = "2022.11.09"

Nums.append(num)
# ---------- end python_5 ----------
tau_d = Panel("""2.317
2.303
2.223
2.191
2.229
2.263
2.249
2.29
2.343
2.365
2.334
2.307""")
graph = QuickGraph([python_2.Reflects, python_2.Refracts], SortOrder=0)  # disabled
panel = Panel("461")
ashrae_sunpath = ASHRAESunPath(
    Latitude="51.902055",
    Longitude="4.484308",
    TimeZone="1",
    Month=python_5,
    Day=python_4,
    Hour=python_3,
    Taus_b=tau_b,
    Taus_d=tau_d)  # -> Recipes; inputs TimeZone: Int32, Month: list of Int32, Day: list of Int32, Hour: list, Taus_b: list, Taus_d: list
# ---------- ashrae_sunpath: Python ----------
"""Calculate the solar angles in target times.
    Inputs:
        Latitude: The latitude number of site in degree
        Longitude: The longitude number of site in degree
        TimeZone: The time zone number of site, 0 for London, 8 for Beijing
        Month: The target months, 1 to 12, single or multiple
        Day: The target days, single or multiple
        Hour:  The target hours, single or multiple
        Taus_b: The optical depths of beam light, average of month
        Taus_d: The optical depths of diffused light, average of month
    Output:
        Recipes: The recipes including datetime and solar information"""

__author__ = "ccy"
__version__ = "2021.11.04"

import Rhino.Geometry as rg
from math import sin, asin, cos, acos, radians, degrees, pi, exp
from datetime import datetime, date

class Recipe:
    def __init__(self, mon, day, hr, alt, azi, vect, E_b, E_d):
        txt_mon = self._prepare(mon)
        txt_day = self._prepare(day)
        txt_hr = self._prepare(hr)
        self.timestamp = txt_mon + '_' + txt_day + '_' + txt_hr
        self.altitude = alt
        self.azimuth = azi
        self.sunvect = vect
        self.irr_beam = E_b
        self.irr_diff = E_d
    
    def __repr__(self):
        return 'Weather_object<%s>' % self.timestamp
    
    def _prepare(self, num):
        if num < 10:
            txt = '0' + str(num)
        else:
            txt = str(num)
        return txt

def get_annual_day(year, month, day):
    try:
        day_now = date(year, month, day)
        day_start = date(year, 1, 1)
        day_delta = day_now - day_start
        num = day_delta.days + 1
        return num
    except:
        return None

def get_solar_time(n, LST, LON, TZ):
    Tau = radians(360 * (n - 1) / 365)
    ET = 2.2918 * (0.0075 + 0.1868*cos(Tau) - 3.2077*sin(Tau) -
         1.4615*cos(2*Tau) - 4.089*sin(2*Tau))
    LSM = 15 * TZ
    AST = LST + ET/60 + (LON - LSM)/15
    return AST

def get_irradiance(alt, n, Tau_b, Tau_d):
    #Calculate the extraterrestrial radiant flux E0
    Esc = 1367
    E0 = Esc * (1 + 0.033*cos(radians(360*(n-3)/365)))
    
    #Calculate the air mass exponents
    ab = 1.454 - 0.406*Tau_b - 0.268*Tau_d + 0.021*Tau_b*Tau_d
    ad = 0.507 + 0.205*Tau_b - 0.080*Tau_d - 0.190*Tau_b*Tau_d
    
    #Calculate the air mass
    m = 1 / (sin(alt) + 0.50572*pow((6.07995+alt),-1.6364))
    
    #Calculate the beam normal irradiance
    E_b = E0 * exp(-Tau_b * pow(m, ab))
    E_d = E0 * exp(-Tau_d * pow(m, ad))
    return E_b, E_d

def get_solar_position(LAT, LON, TZ, doy, hh, tau_b, tau_d):
    if hh > 0 and hh <= 24:
        #---/Find the apparant solar time/---
        time_solar = get_solar_time(doy, hh, LON, TZ)
        
        #---/Find the declination angle in radians/---
        declin = radians(23.45 * sin(radians(360 * (doy + 284) / 365)))
        
        #---/Find the hour angle in radians/---
        H = radians(15 * (time_solar - 12))
        
        #---/Find the solar altitude angle in radians/---
        alt = asin(cos(radians(LAT)) * cos(declin) * cos(H) +
                        sin(radians(LAT)) * sin(declin))
        
        #---/Get the clear sky irradiances/---
        if alt > 0:
            [E_b, E_d] = get_irradiance(alt, doy, tau_b, tau_d)
        else:
            [E_b, E_d] = 0, 0
        
        #---/Find the solar azimuth angle in radians/---
        azi_sin = sin(H) * cos(declin) / cos(alt)
        azi_cos = (cos(H) * cos(declin) * sin(radians(LAT)) - 
                   sin(declin) * cos(radians(LAT))) / cos(alt)
        sun_vect = rg.Vector3d(-azi_sin, -azi_cos, 0)
        azi = rg.Vector3d.VectorAngle(-rg.Vector3d.YAxis, sun_vect,
                                      rg.Plane.WorldXY)
        if azi > pi:
            azi -= pi * 2
        
        #---/treat the results/---
        pln_ref = rg.Plane(rg.Point3d.Origin, sun_vect, rg.Vector3d.ZAxis)
        sun_vect.Rotate(alt, pln_ref.ZAxis)
        sun_vect.Unitize()
        sun_vect = -sun_vect
        altitude = degrees(alt)
        azimuth = degrees(azi)
        return altitude, azimuth, sun_vect, E_b, E_d

Recipes = []

if (Latitude >= -90 and Latitude <= 90 and Longitude >= -180
    and Longitude <= 180 and Month and Day and Hour and
    Taus_b and Taus_b[0] != None and len(Taus_b) == 12 and
    Taus_d and Taus_d[0] != None and len(Taus_d) == 12):
    for mon in Month:
        tau_b = Taus_b[mon - 1]
        tau_d = Taus_d[mon - 1]
        for day in Day:
            doy = get_annual_day(2022, mon, day)
            if doy:
                for hr in Hour:
                    [alt, azi, vect, E_b, E_d] = get_solar_position(Latitude,
                                  Longitude, TimeZone, doy, hr, tau_b, tau_d)
                    if alt > 10:
                        recipe = Recipe(mon, day, hr, alt, azi, vect, E_b, E_d)
                        Recipes.append(recipe)
# ---------- end ashrae_sunpath ----------
mesh = Mesh(<mesh referenced from the Rhino model>)
mesh_2 = Mesh(<mesh referenced from the Rhino model>)
mesh_3 = Mesh(<mesh referenced from the Rhino model>)
mesh_4 = Mesh([<mesh referenced from the Rhino model> x18])
mjoin = MeshJoin(Meshes=mesh)
mjoin_2 = MeshJoin(Meshes=mesh_2)
mjoin_3 = MeshJoin(Meshes=mesh_3)
mjoin_4 = MeshJoin(Meshes=mesh_4)
python_6 = GhPythonScript(mesh=mjoin, name="Panel", size="0.1", sample="2", refract="2.17", metalic="9")  # -> material; inputs mesh: Mesh, sample: Int32
# ---------- python_6: Python ----------
import Rhino.Geometry as rg
from math import cos

class Material:
    #---/Private methods/---
    def __init__(self, mesh, txt, num1, num2, num3, num4):
        self.mesh = mesh
        self.tag = txt
        self.size = num1
        self.sample = num2
        self._refract = num3
        self._metalic = num4
    
    def __repr__(self):
        return 'Material_object<%s>' % self.tag
    
    #---/Public function methods/---
    def reflect(self, ang_inci):
        """Calculate metal reflectivity according to angle"""
        #---///Prepare the parts///---
        n_1 = 1
        n_2 = self._refract
        k_2 = self._metalic
        t1 = n_2 * n_2 + k_2 * k_2
        t2 = 2 * n_2 * cos(ang_inci)
        t3 = cos(ang_inci) * cos(ang_inci)
    
        #---///Calculate Reflectance///---
        Rs = (t1 - t2 + t3) / (t1 + t2 + t3)
        Rp = (t1 * t3 - t2 + 1) / (t1 * t3 + t2 + 1)
        reflect = 0.5 * (Rs + Rp)
        refract = 0
        return reflect, refract

material = Material(mesh, name, size, sample, refract, metalic)
# ---------- end python_6 ----------
python_7 = GhPythonScript(mesh=mjoin_2, name="Skylight", size="0.1", sample="1", refract="2.07")  # -> material; inputs mesh: Mesh, sample: Int32
# ---------- python_7: Python ----------
import Rhino.Geometry as rg
from math import sin, tan, asin

class Material:
    #---/Private methods/---
    def __init__(self, mesh, txt, num1, num2, num3):
        self.mesh = mesh
        self.tag = txt
        self.size = num1
        self.sample = num2
        self._refract = num3
    
    def __repr__(self):
        return 'Material_object<%s>' % self.tag
    
    #---/Public function methods/---
    def reflect(self, ang_inci):
        """Calculate glass reflectivity according to angle"""
        n_1 = 1
        n_2 = self._refract
        if ang_inci == 0:
            R = pow((n_1 - n_2) / (n_1 + n_2), 2)
        else:
            ang_refr = asin(n_1 / n_2 * sin(ang_inci))
            r_norm = pow(sin(ang_inci - ang_refr) / sin(ang_inci + ang_refr), 2)
            r_para = pow(tan(ang_inci - ang_refr) / tan(ang_inci + ang_refr), 2)
            R = 0.5 * (r_norm + r_para)
        reflect = 2 * R / (1 + R)
        refract = abs(-0.0084 * ang_inci * ang_inci * ang_inci -
                      0.0757 * ang_inci * ang_inci + 0.0203 * ang_inci + 0.1853)
        return reflect, refract

material = Material(mesh, name, size, sample, refract)
# ---------- end python_7 ----------
python_8 = GhPythonScript(mesh=mjoin_3, name="Ground", size="0.1", sample="1")  # -> material; inputs mesh: Mesh, sample: Int32
# ---------- python_8: Python ----------
import Rhino.Geometry as rg

class Material:
    #---/Private methods/---
    def __init__(self, mesh, txt, num1, num2):
        self.mesh = mesh
        self.tag = txt
        self.size = num1
        self.sample = num2
    
    def __repr__(self):
        return 'Material_object<%s>' % self.tag
    
    #---/Public function methods/---
    def reflect(self, ang_inci):
        return 0, 0

material = Material(mesh, name, size, sample)
# ---------- end python_8 ----------
python_9 = GhPythonScript(mesh=mjoin_4, name="Air", size="0.1")  # -> air; inputs mesh: Mesh
# ---------- python_9: Python ----------
import Rhino.Geometry as rg

class Air:
    #---/Private methods/---
    def __init__(self, mesh, txt, num):
        self.mesh = mesh
        self.tag = txt
        self.size = num
        self.sample = 0
    
    def __repr__(self):
        return 'Air_object<%s>' % self.tag

air = Air(mesh, name, size)
# ---------- end python_9 ----------
python_10 = GhPythonScript(step=Slider(392, range=-1..459), Recipes=ashrae_sunpath)  # -> Message, recipe; inputs step: Int32, Recipes: list
# ---------- python_10: Python ----------
if step >= 0:
    # Get the desired recipes
    recipe = Recipes[step]
    recipe_last = Recipes[-1]
    
    # Get the step and make comment on it
    step_max = len(Recipes) - 1
    step_left = step_max - step
    if step_left == 0:
        comment = "Finished! That's a loooooong day"
    elif step_left == step_max:
        comment = "Woo~ The journey starts......"
    elif step_left > step_max / 2:
        comment = "May Barbatos bless you......"
    else:
        comment = "Hold on! We are almost there!"
    
    irr_beam = "{:.1f}".format(recipe.irr_beam)
    irr_diff = "{:.1f}".format(recipe.irr_diff)
    
    # Display the message
    Message = """On step: {0}, maximum step: {1}, left {2} to go
    Current Time: {3}
    Maximum Time: {4}
    Current Beam Normal Irradiance: {5} W/m^2
    Current Diffuse Horizontal Irradiance: {6} W/m^2
    {7}""".format(step, step_max, step_left,
                  recipe.timestamp, recipe_last.timestamp,
                  irr_beam, irr_diff, comment)
# ---------- end python_10 ----------
merge = Merge(Data1=python_6, Data2=python_7, Data3=python_8, Data4=python_9)
falsestart = LBFalseStartToggle(False)
panel_2 = Panel(python_10.Message)
python_11 = GhPythonScript(Materials=merge, gen_it=falsestart)  # -> Scenes, Checks; inputs Materials: list, gen_it: Boolean
# ---------- python_11: Python ----------
import Rhino.Geometry as rg
import scriptcontext as sc
from math import cos
import ghpythonlib.parallel

#----------///The class definitions///----------
class Scene:
    #---/Private methods/---
    def __init__(self, txt):
        self._archive = {}
        self._library = {}
        self._tag = txt
    
    def __repr__(self):
        return 'scene_object<%s>' % self._tag
    
    #---/Public function methods/---
    def calc_reflection(self, tag, ang_inci):
        [reflect, refract] = self._library[tag].reflect(ang_inci)
        return reflect, refract
    
    #---/Public getters/---
    def get_Panels(self):
        return self._archive.values()
    
    def get_panel(self, idx): #Used in sync_panel for ray
        return self._archive[idx]
    
    def get_mesh(self):
        return self._mesh
    
    #---/Public setters/---
    def add_mesh(self, mesh):
        self._mesh = mesh
    
    def init_panel(self, idx_panel, obj_panel):
        self._archive[idx_panel] = obj_panel
    
    def add_material(self, tag, obj_material):
        self._library[tag] = obj_material

class Panel:
    #---/Private methods/---
    def __init__(self, idx, tag, size, sample):
        self._idx = idx
        self._tag = tag
        self.size = size
        self._sample = sample
        if self._sample:
            length_sample = self.size / self._sample
            self._area_sample = length_sample * length_sample
        else:
            self._area_sample = 0
    
    def __repr__(self):
        return '%s_object_<%s>' % (self._tag, self._idx)
    
    #---/Private function methods/---
    
    #---/Public function methods/---
    def prepare(self, scene):
        #-/Generate new mesh from face/-
        mesh = _get_face_mesh(scene.get_mesh(), self._idx)
        
        #-/Get basic information/-
        self._vect = mesh.NormalAt(0, 0.5, 0, 0.5, 0)
        self._pt = mesh.PointAt(0, 0.5, 0, 0.5, 0)
        
        if self._sample:
            #-/Get on-plane boundingbox of mesh/-
            pt_targ = ((mesh.PointAt(0, 1, 0, 0, 0) +
                        mesh.PointAt(0, 0, 1, 0, 0)) / 2)
            pln = get_pln(self._pt, self._vect, pt_targ)
            bbox = mesh.GetBoundingBox(pln)
            if bbox.IsDegenerate(TOL) == 1:
                #-/Generate 2D box with good bounding box/-
                box = rg.Box(bbox)
            else:
                #-/Generate again/-
                mesh_flat = mesh.Duplicate()
                smash = rg.Transform.ProjectAlong(pln, pln.ZAxis)
                mesh_flat.Transform(smash)
                bbox = mesh_flat.GetBoundingBox(pln)
                if bbox.IsDegenerate(TOL) != 1:
                    Checks.append(self._pt)
                    #raise Exception('The quad mesh is not flat!')
                box = rg.Box(bbox)
            
            #-/Generate plane mesh with spacing/-
            mesh_box = rg.Mesh.CreateFromPlane(rg.Plane.WorldXY,
                       box.X, box.Y, self._sample, self._sample)
            trans1 = rg.Transform.PlaneToPlane(rg.Plane.WorldXY, pln)
            trans2 = rg.Transform.Translation(self._vect)
            mesh_box.Transform(trans1)
            mesh_box.Transform(trans2)
            
            #-/use mesh ray to filter the on-mesh points/-
            Pts = []
            for idx in range(mesh_box.Faces.Count):
                pt = mesh_box.PointAt(idx, 0.5, 0, 0.5, 0)
                Pts.append(pt)
            self._Pts = []
            for pt in Pts:
                ray = rg.Ray3d(pt, -self._vect)
                dist = rg.Intersect.Intersection.MeshRay(mesh, ray)
                if dist >= 0:
                    self._Pts.append(pt - self._vect)
        else:
            self._Pts = []
    
    def is_sunlit(self, vect_in):
        if self._Pts and self._vect * vect_in < 0:
            return True
        else:
            return False
    
    def refresh(self):
        self._factor = 0
    
    def calc_area_lumen(self, vect_sun_earth):
        pln = rg.Plane(self._pt, -vect_sun_earth, self._vect)
        inci = rg.Vector3d.VectorAngle(-vect_sun_earth, self._vect, pln)
        area_out = self._area_sample * cos(inci)
        return area_out
    
    def add_factor(self, num):
        self._factor += num
    
    #---/Public getters/---
    def get_Pts(self):
        return self._Pts
    
    def get_norm(self):
        return self._vect
    
    def get_idx(self):
        return self._idx
    
    def get_tag(self):
        return self._tag
    
    def get_factor(self):
        return self._factor

#----------///The function definitions///----------
def init_scene(Objs, txt):
    #---/Initiate the scene object/---
    scene = Scene(txt)
    idx_panel = 0
    mesh_all = rg.Mesh()
    
    #---/Iterate meshes & initiate the panel objects/---
    for material in Objs:
        mesh = material.mesh
        tag = material.tag
        size = material.size
        sample = material.sample
        scene.add_material(tag, material)
        for idx_face in range(mesh.Faces.Count):
            panel = Panel(idx_panel, tag, size, sample)
            scene.init_panel(idx_panel, panel)
            idx_panel += 1
        mesh_all.Append(mesh)
    scene.add_mesh(mesh_all)
    
    return scene

def _get_face_mesh(mesh, idx):
    #-/Get components from the old mesh/-
    face = mesh.Faces[idx]
    ptA = mesh.Vertices[face.A]
    ptB = mesh.Vertices[face.B]
    ptC = mesh.Vertices[face.C]
    ptD = mesh.Vertices[face.D]
    
    #-/Construct the new mesh/-
    mesh_new = rg.Mesh()
    mesh_new.Vertices.Add(ptA)
    mesh_new.Vertices.Add(ptB)
    mesh_new.Vertices.Add(ptC)
    mesh_new.Vertices.Add(ptD)
    mesh_new.Faces.AddFace(0, 1, 2, 3)
    mesh_new.Normals.ComputeNormals()
    mesh_new.Compact()
    return mesh_new

def get_pln(pto, vect_z, ptx):
    pln = rg.Plane(pto, vect_z)
    vect_x = rg.Vector3d(ptx - pto)
    vect_x.Unitize()
    ang = rg.Vector3d.VectorAngle(pln.XAxis, vect_x, pln)
    pln.Rotate(ang, pln.Normal, pln.Origin)
    return pln

def prepare_solid(panel):
    panel.prepare(scene_solid)

def prepare_air(panel):
    panel.prepare(scene_air)

if gen_it:
    #---/Get the system accuracy (normally 0.001)/---
    TOL = sc.doc.ModelAbsoluteTolerance
    Checks = []
    
    #---/Sperate materials and generate solid & air scenes/---
    Solids = []
    Airs = []
    for material in Materials:
        tag = material.tag
        if tag == 'Air' or tag == 'air':
            Airs.append(material)
        else:
            Solids.append(material)
    
    #---/Iterate dictionary keys parallely and prepare panels/---
    scene_solid = init_scene(Solids, 'Solid')
    ghpythonlib.parallel.run(prepare_solid, scene_solid.get_Panels(), False)
    Scenes = [scene_solid]
    if Airs:
        scene_air = init_scene(Airs, 'Air')
        ghpythonlib.parallel.run(prepare_air, scene_air.get_Panels(), False)
        Scenes.append(scene_air)
# ---------- end python_11 ----------
falsestart_2 = LBFalseStartToggle(False)
python_12 = GhPythonScript(recipe=python_10.recipe)  # -> Paths
# ---------- python_12: Python ----------
import os
import Rhino.RhinoDoc as rrd

if recipe:
    #---///Prepare the folder path part///---
    path_3dm = rrd.ActiveDoc.Path
    folder = os.path.dirname(os.path.abspath(path_3dm))
    folder1 = folder + "\\Logs\\"
    folder2 = folder + "\\Results\\"
    
    #---///Prepare the timestemp part///---
    timestamp = recipe.timestamp
    lst = timestamp.split('_')
    
    #---///Get the whole path///---
    path1 = folder1 + 'Log_' + timestamp + '.txt'
    path2 = folder2 + 'Result_' + timestamp + '.txt'
    path3 = folder2 + 'ResultAir_' + timestamp + '.txt'
    Paths = [path1, path2, path3]
# ---------- end python_12 ----------
python_13 = GhPythonScript(scene=python_11.Scenes, show_it=falsestart_2)  # -> Pts_all; inputs show_it: Boolean
# ---------- python_13: Python ----------
__author__ = "ccy"
__version__ = "2022.11.04"

if show_it:
    Pts_all = []
    for panel in scene.get_Panels():
        Pts = panel.get_Pts()
        Pts_all.extend(Pts)
# ---------- end python_13 ----------
falsestart_3 = LBFalseStartToggle(False)
python_14 = GhPythonScript(recipe=python_10.recipe, Paths=python_12, Scenes=python_11.Scenes, run_it=falsestart_3)  # -> out; inputs Paths: list, Scenes: list, run_it: Boolean
# ---------- python_14: Python ----------
import Rhino.Geometry as rg
import scriptcontext as sc
from System import Array
import clr
import ghpythonlib.parallel

#----------///The class definitions///----------
class Ray:
    #---/Private methods/---
    def __init__(self, idx_panel1, Idcs_panel2,
                 pt_in, vect, trans, area, portion):
        pt = rg.Point3d(pt_in)
        pt.Transform(trans)
        self._Pts = [pt]
        self._Vects = [vect]
        self._area = area
        self._portion = [portion]
        if Idcs_panel2:
            self._status = 1 #The ray is already initiated
            self._tag = 'I_' + str(idx_panel1)
            self._Idcs_face = [Idcs_panel2]
        else:
            self._status = 0 #The ray is waiting to be initiated
            self._tag = 'O_' + str(idx_panel1)
            self._Idcs_face = []
        self._pool = []
    
    #---/Private function methods/---
    def _sync_panel(self, Lst, vect_ray):
        #-/Read information from the scene archive by indices/-
        valid = False
        vect = rg.Vector3d.Zero
        Lst_tag = []
        factor = self._portion[-1] * self._area
        for idx in Lst:
            panel = scene_solid.get_panel(idx)
            vect_panel = panel.get_norm()
            if vect_panel * vect_ray < 0:
                valid = True
                panel.add_factor(factor)
                vect += panel.get_norm()
                tag = panel.get_tag()
                if not tag in Lst_tag:
                    Lst_tag.append(tag)
        if valid:
            vect.Unitize()
            tag = Lst_tag[0]
            return vect, tag
        else:
            #-/Turn to the terminating routine/-
            self._status = -1 #Ray get lost
            return None, None
    
    def _sync_air(self, idx, portion):
        factor = portion * self._area
        panel = scene_air.get_panel(idx)
        panel.add_factor(factor)
    
    #---/Public function methods/---
    def forward(self, mesh):
        #-/Prepare the basic forward recipe/-
        adjust = TOL
        Idcs = clr.StrongBox[Array[int]]()
        Lst_idx = []
        pt = self._Pts[-1]
        vect = self._Vects[-1]
        pt_start = pt + vect * adjust
        
        #-/Initial forward to see if missed anything/-
        ray = rg.Ray3d(pt_start, -vect)
        dist = rg.Intersect.Intersection.MeshRay(mesh, ray, Idcs)
        Lst_check = list(Idcs.Value)
        if (dist > 0 and dist < vect.Length * adjust and
                       Lst_check != self._Idcs_face[-1]):
            #-/Really missed something/-
            pt_new = pt_start - vect * dist
            Lst_idx.extend(Lst_check)
        else:
            #-/Not missing anything/-
            ray = rg.Ray3d(pt_start, vect)
            dist = rg.Intersect.Intersection.MeshRay(mesh, ray, Idcs)
            if dist > 0:
                pt_new = pt_start + vect * dist
                Lst_idx.extend(list(Idcs.Value))
            else:
                #-/Turn to the terminating routine/-
                self._status = -1 #Ray get lost
                dist = 20
                pt_new = pt_start + vect * dist
        return pt_new, Lst_idx
    
    def reflect(self, mesh, pt, Lst_idx):
        if self._status == 1 or self._status == 0:
            #-/The ray is on going or is waiting to be initiated/-
            #-/Attract information from the panels/-
            [vect_norm, tag] = self._sync_panel(Lst_idx, self._Vects[-1])
            
            if self.is_valid():
                #-/Calculate the incident angle/-
                pln = rg.Plane(pt, vect_norm, -self._Vects[-1])
                rad = rg.Vector3d.VectorAngle(vect_norm, -self._Vects[-1], pln)
                [reflect, refract] = scene_solid.calc_reflection(tag, rad)
                
                #-/Prepare recipe for new refract ray/-
                if refract:
                    self._pool.append([pt, self._Vects[-1],
                                       self._portion[-1] * refract,
                                       Lst_idx])
                #-/Continue reflecting/-
                self._portion.append(self._portion[-1] * reflect)
            if self.is_valid():
                #-/Reflection/-
                vect_cross = rg.Vector3d.CrossProduct(vect_norm, -self._Vects[-1])
                pln = rg.Plane(pt, vect_norm, vect_cross)
                trans = rg.Transform.Mirror(pln)
                vect_reflect = rg.Vector3d(-self._Vects[-1])
                vect_reflect.Transform(trans)
                
                #-/Record this reflection for the next forward/-
                self._Vects.append(vect_reflect)
            
            #-/Record the last forward
            self._Pts.append(pt)
            self._Idcs_face.append(Lst_idx)
        elif self._status == -1:
            #-/The ray get lost in the last forwarding/-
            #-/Terminating the ray with appending the last points/-
            self._Pts.append(pt)
    
    def initiate(self, panel, mesh):
        #-/Initial forward (ray sunlit check)/-
        [pt_hit, Idcs_face] = self.forward(mesh)
        if len(Idcs_face) == 1 and Idcs_face[0] == panel.get_idx():
            self._status = 1 #The ray is initiated
            self.reflect(mesh, pt_hit, Idcs_face)
    
    def cross_air(self, mesh):
        #-/Generate lines from the ray points/-
        for idx in range(len(self._Pts) - 1):
            ln = rg.Line(self._Pts[idx], self._Pts[idx + 1])
            #-/get corresponding portion of the current line/-
            portion = self._portion[idx]
            Idcs = clr.StrongBox[Array[int]]()
            Pts = rg.Intersect.Intersection.MeshLine(mesh, ln, Idcs)
            Lst_idx = list(Idcs.Value)
            for idx_panel in Lst_idx:
                self._sync_air(idx_panel, portion)
    
    #---/Public getters/---
    def is_valid(self):
        if self._status == 1 and self._portion[-1] > 0.1:
            return True
        else:
            return False
    
    def get_tag(self):
        return self._tag
    
    def get_Idcs(self):
        Lst_txt = []
        for Lst_idx in self._Idcs_face:
            Lst_txt_sub = []
            for idx in Lst_idx:
                Lst_txt_sub.append(str(idx))
            txt_sub = '^'.join(Lst_txt_sub)
            Lst_txt.append(txt_sub)
        return Lst_txt
    
    def get_pool(self):
        return self._pool
    
    def get_plc(self): #for test
        if self._Pts and len(self._Pts) > 1:
            plc = rg.PolylineCurve(self._Pts)
            return plc
        else:
            return self._Pts

#----------///The function definitions///----------
def get_sun_pln(mesh, vect):
    """Get the solar angle plane over the target mesh"""
    bbox = mesh.GetBoundingBox(False)
    ptc = bbox.Center
    radius = bbox.Diagonal.Length / 2
    pt = ptc - vect * radius
    pln = rg.Plane(pt, vect)
    return pln

def ray_shoot(ray):
    #-/Normal routine, if not valid, will be passed/-
    count = 0
    while ray.is_valid() and count < 10:
        [pt_hit, Idcs_face] = ray.forward(MESH)
        ray.reflect(MESH, pt_hit, Idcs_face)
        count += 1
    
    #-/Test ray intersect with the airmesh/-
    if scene_air:
        ray.cross_air(MESH_AIR)
    
    #-/Collect log information/-
    txt_tag = ray.get_tag()
    txt_panel = ','.join(ray.get_Idcs())
    txt = txt_tag + '_' + txt_panel
    
    return txt

#----------///Main///----------
def Main(panel):
    if panel.is_sunlit(vect_sun):
        area_lumen = panel.calc_area_lumen(vect_sun)
        Lst_log = []
        Pool_refract = []
        
        #-/The original rays for reflections/-
        Pts = panel.get_Pts()
        idx = panel.get_idx()
        for pt in Pts:
            #-/Declare a new ray/-
            ray = Ray(idx, None, pt, vect_sun, trans_sun, area_lumen, 1.0)
            #-/1st round forward & reflect for sunlit check/-
            ray.initiate(panel, MESH)
            #-/Normal routine/-
            txt = ray_shoot(ray)
            if not txt in Lst_log:
                Lst_log.append(txt)
            Pool_refract.extend(ray.get_pool())
        
        #-/New rays of refractions/-
        for Lst_recipe in Pool_refract:
            #-/Declare a new ray/-
            pt = Lst_recipe[0]
            vect_ray = Lst_recipe[1]
            trans_ray = rg.Transform.Translation(vect_ray * TOL)
            portion = Lst_recipe[2]
            Idcs = Lst_recipe[3]
            ray = Ray(idx, Idcs, pt, vect_ray, trans_ray, area_lumen, portion)
            #-/Normal routine/-
            txt = ray_shoot(ray)
            if not txt in Lst_log:
                Lst_log.append(txt)
        
        #-/Summary/-
        txt_sum = '\n'.join(Lst_log)
    else:
        txt_sum = ''
    return txt_sum

if run_it and recipe:
    #---/Get the system accuracy (normally 0.001)/---
    TOL = sc.doc.ModelAbsoluteTolerance
    
    #---/Get the scenes/---
    scene_solid = Scenes[0]
    if len(Scenes) == 2:
        scene_air = Scenes[1]
    else:
        scene_air = None
    
    #---/Set the sun related inputs/---
    vect_sun = recipe.sunvect
    pln_sun = get_sun_pln(scene_solid.get_mesh(), vect_sun) #Solar plane
    trans_sun = rg.Transform.ProjectAlong(pln_sun, vect_sun)
    
    #---/initialize this run/---
    MESH = scene_solid.get_mesh()
    for panel in scene_solid.get_Panels():
        panel.refresh()
    
    if scene_air:
        MESH_AIR = scene_air.get_mesh()
        for panel in scene_air.get_Panels():
            panel.refresh()
    
    #---/Proceed Ray-Tracing in parallel/---
    Logs = ghpythonlib.parallel.run(Main, scene_solid.get_Panels(), False)
    with open(Paths[0], 'w') as file:
        for txt_log in Logs:
            if txt_log:
                file.write(txt_log)
                file.write('\n')
    
    #---/Extract the energy information of solid panels/---
    Energies_solid = []
    irr_beam = recipe.irr_beam
    irr_diff = recipe.irr_diff
    for panel in scene_solid.get_Panels():
        energy = (irr_beam * panel.get_factor() / panel.size / panel.size + 
                  irr_diff)
        Energies_solid.append(str(energy))
    txt_energy = '\n'.join(Energies_solid)
    with open(Paths[1], 'w') as file:
        file.write(txt_energy)
    
    #---/Extract the energy information of air panels/---
    Energies_air = []
    for panel in scene_air.get_Panels():
        energy = (irr_beam * panel.get_factor() / panel.size / panel.size + 
                  irr_diff)
        Energies_air.append(str(energy))
    txt_energy = '\n'.join(Energies_air)
    with open(Paths[2], 'w') as file:
        file.write(txt_energy)
# ---------- end python_14 ----------
panel_3 = Panel(python_14)
item = ListItem(List=python_12, Index=0, Wrap=True)  # -> Item, Item1, Item2
item_2 = ListItem(List=python_11.Scenes, Index=0, Wrap=True)  # -> Item, Item1
falsestart_4 = LBFalseStartToggle(False)
python_15 = GhPythonScript(scene=item_2.Item, path=item.Item1, Bool=falsestart_4)  # -> mesh, Energies; inputs Bool: Boolean
# ---------- python_15: Python ----------
__author__ = "ccy"
__version__ = "2021.12.24"

Energies = []
if path and Bool:
    mesh = scene.get_mesh()
    Energies = []
    with open(path, 'r') as file:
        for idx, txt in enumerate(file):
            Lst_info = txt.split(';')
            energy = float(Lst_info[0])
            Energies.append(energy)
# ---------- end python_15 ----------
bnd = Bounds(Numbers=python_15.Energies)
dedomain = DeconstructDomain(Domain=bnd)  # -> Start, End
Z = UnitZ(Factor=1)
pt = Point(Point(12.55281192, -10.00085862, 0))
line = Line(Line((32.36429859, 27.54514511, 0), (27.32047881, 2.817719548, 0)))
panel_4 = Panel("y")
line_2 = Line(Line((-0.55, 1.15, 0), (-0.45, 1.05, 0)))
falsestart_5 = LBFalseStartToggle(False)
midpt = CurveMiddle(Curve=line_2)
falsestart_6 = LBFalseStartToggle(False)
xy = XYPlane(Origin=pt)
python_16 = GhPythonScript(scene=item_2.Item, pt=midpt, radius="0.05", run_it=falsestart_5)  # -> sphere, Idcs_panel; inputs pt: Point3d, run_it: Boolean
# ---------- python_16: Python ----------
__author__ = "ccy"
__version__ = "2022.11.07"

import Rhino.Geometry as rg

#----------///The function definitions///----------
def get_tree(mesh):
    tree = rg.RTree()
    for idx in range(mesh.Faces.Count):
        pt= mesh.PointAt(idx, 0.5, 0, 0.5, 0)
        tree.Insert(pt, idx)
    return tree

def SearchCallback(sender, e):
        Idcs_panel.append(e.Id)

if run_it:
    #-/Get the target face indices/-
    mesh = scene.get_mesh()
    tree = get_tree(mesh)
    sphere = rg.Sphere(pt, radius)
    Idcs_panel = []
    tree.Search(sphere, SearchCallback, Idcs_panel)
# ---------- end python_16 ----------
gradient = Gradient(
    LowerLimit="4000",
    UpperLimit="0",
    Parameter=python_15.Energies,
    stops=[0: RGB(255, 251, 0), 0: RGB(255, 255, 0), 0.25: RGB(255, 140, 0), 0.5: RGB(252, 11, 3), 0.75: RGB(133, 0, 122), 1: RGB(0, 0, 252)])
python_17 = GhPythonScript(Location=xy, LowerBound="0", UpperBound="4000", Segments="9", FineColourFactor="10", LegendScale="2", Decimo="0")  # -> mesh, Params, Value_Plns, Value_Txts, Top_Pln, Bot_Pln; inputs Location: Plane, Segments: Int32, FineColourFactor: Int32, Decimo: Int32
# ---------- python_17: Python ----------
"""Provides a scripting component.
    Inputs:
        Location: The plane indicating location of legend
        LowerBound: The min value of data range
        UpperBound: The max value of data range
        Segments: The number of steps for data range, integer
        FineColourFactor: [Optional] The factor for having fine colour display, integer
        LegendScale: [Optional] The display scale of legend, the default width is 1mm
        LegendTitle: [Optional] The text contains title for this legend
    Output:
        mesh: The output mesh as the hoster of legend
        Params: The array of number for data segments
        Plns: The planes indicating the location planes for text tag 3D
        Texts: The strings containing legend labels and the title"""

from ghpythonlib.componentbase import executingcomponent as component
import Grasshopper, GhPython
import System
import Rhino
import Rhino.Geometry as rg

def get_series(low, up, segment, fine):
    num_block = (segment - 1) * fine
    step = (up - low) / num_block
    Results = []
    count = low
    for i in range(num_block + 1):
        Results.append(count)
        count += step
    return Results

def get_mesh(pln, num_txt, num_mesh, scale):
    dom1 = rg.Interval(0, scale)
    dom2 = rg.Interval(0, scale * num_txt)
    mesh = rg.Mesh.CreateFromPlane(pln, dom1, dom2, 1, num_mesh)
    return mesh

def get_txt_plns(pln_ref, num_txt, num_mesh, scale, fine):
    vect_x = pln_ref.XAxis * scale
    vect_y = pln_ref.YAxis * scale * num_txt / num_mesh
    pt = pln_ref.Origin + vect_x / 2 - vect_y * fine
    pln1 = rg.Plane(pt, vect_x, vect_y)
    pt = pt + vect_x * 0.7 + vect_y * (fine + 0.5)
    Plns = []
    for i in range(num_txt):
        pln = rg.Plane(pt, vect_x, vect_y)
        Plns.append(pln)
        pt += vect_y * fine
    pt = pt - vect_x * 0.7
    pln2 = rg.Plane(pt, vect_x, vect_y)
    return Plns, pln1, pln2

def get_txts(Lst, dec):
    form = "{:." + str(dec) + "f}"
    Lst_txt = []
    for item in Lst:
        Lst_txt.append(form.format(item))
    return Lst_txt

class MyComponent(component):
    def RunScript(self, Location, LowerBound, UpperBound, Segments,
                  FineColourFactor, LegendScale, Decimo):
        if not FineColourFactor:
            FineColourFactor = 1
        if not LegendScale:
            LegendScale = 1
        if Decimo == None or Decimo < 0:
            Decimo = 3
        mesh, Params, Plns, Texts = None, None, None, None
        if Location and LowerBound or LowerBound == 0 and UpperBound and Segments:
            # Get coarse and fine lists
            Params = get_series(LowerBound, UpperBound, Segments, FineColourFactor)
            Nums = get_series(LowerBound, UpperBound, Segments, 1)
            # make mesh and text planes based on the fine and coarse lists
            mesh = get_mesh(Location, len(Nums), len(Params), LegendScale)
            [Value_Plns, Bot_Pln, Top_Pln] = get_txt_plns(Location,
             len(Nums), len(Params), LegendScale, FineColourFactor)
            # make txt based on the coarse list
            Value_Txts = get_txts(Nums, Decimo)
        return (mesh, Params, Value_Plns, Value_Txts, Top_Pln, Bot_Pln)
# ---------- end python_17 ----------
python_18 = GhPythonScript(scene=item_2.Item1, threshold="3000", path=item.Item2, Bool=falsestart_6)  # -> Energies, mesh, pack_keep, pack_remove; inputs Bool: Boolean
# ---------- python_18: Python ----------
#----------///The class definitions///----------
class Package:
    #---/Private methods/---
    def __init__(self):
        self._Lst = []
    
    def __repr__(self):
        return 'scene_object<%s>' % str(len(self._Lst))
    
    #---/Public methods/---
    def add(self, num):
        self._Lst.append(num)
    
    def get(self):
        return self._Lst

if path and Bool:
    mesh = scene.get_mesh()
    Energies = []
    pack_keep = Package()
    pack_remove = Package()
    with open(path, 'r') as file:
        for idx, txt in enumerate(file):
            Lst_info = txt.split(';')
            energy = float(Lst_info[0])
            Energies.append(energy)
            if energy >= threshold:
                pack_keep.add(idx)
            else:
                pack_remove.add(idx)
# ---------- end python_18 ----------
falsestart_7 = LBFalseStartToggle(False)
brep = Brep(python_16.sphere)
bnd_2 = Bounds(Numbers=python_17.Params)
gradient_2 = Gradient(
    LowerLimit="8000",
    UpperLimit="0",
    Parameter=python_18.Energies,
    stops=[0: RGB(255, 251, 0), 0: RGB(255, 255, 0), 0.25: RGB(255, 140, 0), 0.5: RGB(252, 11, 3), 0.75: RGB(133, 0, 122), 1: RGB(0, 0, 252)])
python_19 = GhPythonScript(path=item.Item, Idcs_panel=python_16.Idcs_panel, run_it=falsestart_7)  # -> Idcs_shoot; inputs Idcs_panel: list of Int32, run_it: Boolean
# ---------- python_19: Python ----------
import os
import Rhino.RhinoDoc as rrd
import ghpythonlib.parallel

#----------///The function definitions///----------
def get_beginner(txt):
    idx_out = None
    Lst_all = txt.split('_')
    txt_panel = Lst_all[-1]
    try:
        Lst_idx = txt_panel.split(',')
        for txt_idx in Lst_idx:
            idx_pass = int(txt_idx)
            if idx_pass in Idcs_panel:
                idx_out = int(Lst_all[1])
                break
    except:
        pass
    return idx_out

if run_it:
    #-/Get the log information of the targets/-
    with open(path, 'r') as file:
        Lst_txt = file.readlines()
    Idcs_raw = ghpythonlib.parallel.run(get_beginner, Lst_txt, False)
    Idcs_shoot = []
    for idx_raw in Idcs_raw:
        if idx_raw and not idx_raw in Idcs_shoot:
            Idcs_shoot.append(idx_raw)
# ---------- end python_19 ----------
python_20 = GhPythonScript(mesh=python_15.mesh, Colors=gradient)  # -> mesh; inputs mesh: Mesh, Colors: list of Color
# ---------- python_20: Python ----------
__author__ = "ccy"
__version__ = "2021.12.09"

# Color the mesh
mesh.VertexColors.CreateMonotoneMesh(Colors[0])
mesh.Unweld(0, False)
for i in range(mesh.Faces.Count):
    face = mesh.Faces[i]
    color = Colors[i]
    mesh.VertexColors.SetColor(face, color)
# ---------- end python_20 ----------
dedomain_2 = DeconstructDomain(Domain=bnd_2)  # -> Start, End
falsestart_8 = LBFalseStartToggle(False)
gradient_3 = Gradient(
    LowerLimit=dedomain_2.End,
    UpperLimit=dedomain_2.Start,
    Parameter=python_17.Params,
    stops=[0: RGB(255, 251, 0), 0: RGB(255, 255, 0), 0.25: RGB(255, 140, 0), 0.5: RGB(252, 11, 3), 0.75: RGB(133, 0, 122), 1: RGB(0, 0, 252)])
python_21 = GhPythonScript(num=dedomain.End)  # -> Message
# ---------- python_21: Python ----------
__author__ = "ccy"
__version__ = "2021.11.23"

Message = "Max Irradiance: " + "{:.1f}".format(num) + " W/m^2"
# ---------- end python_21 ----------
pt_2 = Point(Point(19.27399999, -27.01614215, 33.72427259))
line_3 = Line(Line((32.36429859, 27.54514511, 0), (27.32047881, 2.817719548, 0)))
falsestart_9 = LBFalseStartToggle(False)
python_22 = GhPythonScript(recipe=python_10.recipe, scene=item_2.Item, Idcs_termin=python_16.Idcs_panel, Idcs_shoot=python_19, run_it=falsestart_8)  # -> out, Rays, Checks; inputs Idcs_termin: list of Int32, Idcs_shoot: list of Int32, run_it: Boolean
# ---------- python_22: Python ----------
import Rhino.Geometry as rg
import scriptcontext as sc
from System import Array
import clr
import ghpythonlib.parallel

#----------///The class definitions///----------
class Ray:
    #---/Private methods/---
    def __init__(self, idx_panel1, Idcs_panel2,
                 pt_in, vect, trans, area, portion):
        pt = rg.Point3d(pt_in)
        pt.Transform(trans)
        self._Pts = [pt]
        self._Vects = [vect]
        self._area = area
        self._portion = [portion]
        if Idcs_panel2:
            self._status = 1 #The ray is already initiated
            self._tag = 'I_' + str(idx_panel1)
            self._Idcs_face = [Idcs_panel2]
        else:
            self._status = 0 #The ray is waiting to be initiated
            self._tag = 'O_' + str(idx_panel1)
            self._Idcs_face = []
        self._pool = []
    
    #---/Private function methods/---
    def _sync_panel(self, Lst, vect_ray):
        #-/Read information from the scene archive by indices/-
        valid = False
        vect = rg.Vector3d.Zero
        Lst_tag = []
        factor = self._portion[-1] * self._area
        for idx in Lst:
            panel = scene.get_panel(idx)
            vect_panel = panel.get_norm()
            if vect_panel * vect_ray < 0:
                valid = True
                panel.add_factor(factor)
                vect += panel.get_norm()
                tag = panel.get_tag()
                if not tag in Lst_tag:
                    Lst_tag.append(tag)
        if valid:
            vect.Unitize()
            tag = Lst_tag[0]
            return vect, tag
        else:
            #-/Turn to the terminating routine/-
            self._status = -1 #Ray get lost
            return None, None
    
    #---/Public function methods/---
    def forward(self, mesh):
        #-/Prepare the basic forward recipe/-
        adjust = TOL
        Idcs = clr.StrongBox[Array[int]]()
        Lst_idx = []
        pt = self._Pts[-1]
        vect = self._Vects[-1]
        pt_start = pt + vect * adjust
        
        #-/Initial forward to see if missed anything/-
        ray = rg.Ray3d(pt_start, -vect)
        dist = rg.Intersect.Intersection.MeshRay(mesh, ray, Idcs)
        Lst_check = list(Idcs.Value)
        if (dist > 0 and dist < vect.Length * adjust and
                       Lst_check != self._Idcs_face[-1]):
            #-/Really missed something/-
            pt_new = pt_start - vect * dist
            Lst_idx.extend(Lst_check)
        else:
            #-/Not missing anything/-
            ray = rg.Ray3d(pt_start, vect)
            dist = rg.Intersect.Intersection.MeshRay(mesh, ray, Idcs)
            if dist > 0:
                pt_new = pt_start + vect * dist
                Lst_idx.extend(list(Idcs.Value))
            else:
                #-/Turn to the terminating routine/-
                self._status = -1 #Ray get lost
                dist = 20
                pt_new = pt_start + vect * dist
        return pt_new, Lst_idx
    
    def reflect(self, mesh, pt, Lst_idx):
        if self._status == 1 or self._status == 0:
            #-/The ray is on going or is waiting to be initiated/-
            #-/Attract information from the panels/-
            [vect_norm, tag] = self._sync_panel(Lst_idx, self._Vects[-1])
            
            if self.is_valid():
                #-/Calculate the incident angle/-
                pln = rg.Plane(pt, vect_norm, -self._Vects[-1])
                rad = rg.Vector3d.VectorAngle(vect_norm, -self._Vects[-1], pln)
                [reflect, refract] = scene.calc_reflection(tag, rad)
                
                #-/Prepare recipe for new refract ray/-
                if refract:
                    self._pool.append([pt, self._Vects[-1],
                                       self._portion[-1] * refract,
                                       Lst_idx])
                #-/Continue reflecting/-
                self._portion.append(self._portion[-1] * reflect)
            if self.is_valid():
                #-/Reflection/-
                vect_cross = rg.Vector3d.CrossProduct(vect_norm, -self._Vects[-1])
                pln = rg.Plane(pt, vect_norm, vect_cross)
                trans = rg.Transform.Mirror(pln)
                vect_reflect = rg.Vector3d(-self._Vects[-1])
                vect_reflect.Transform(trans)
                
                #-/Record this reflection for the next forward/-
                self._Vects.append(vect_reflect)
            
            #-/Record the last forward
            self._Pts.append(pt)
            self._Idcs_face.append(Lst_idx)
        elif self._status == -1:
            #-/The ray get lost in the last forwarding/-
            #-/Terminating the ray with appending the last points/-
            self._Pts.append(pt)
    
    def initiate(self, panel, mesh):
        #-/Initial forward (ray sunlit check)/-
        [pt_hit, Idcs_face] = self.forward(mesh)
        if len(Idcs_face) == 1 and Idcs_face[0] == panel.get_idx():
            self._status = 1 #The ray is initiated
            self.reflect(mesh, pt_hit, Idcs_face)
    
    #---/Public getters/---
    def is_valid(self):
        if self._status == 1 and self._portion[-1] > 0.1:
            return True
        else:
            return False
    
    def get_idx(self):
        try:
            Lst_idx = []
            for Lst_temp in self._Idcs_face:
                Lst_idx.extend(Lst_temp)
            return Lst_idx
        except:
            return []
    
    def get_pool(self):
        return self._pool
    
    def get_plc(self): #for test
        if self._Pts and len(self._Pts) > 1:
            plc = rg.PolylineCurve(self._Pts)
            return plc
        else:
            return self._Pts

#----------///The function definitions///----------
def get_sun_pln(mesh, vect):
    """Get the solar angle plane over the target mesh"""
    bbox = mesh.GetBoundingBox(False)
    ptc = bbox.Center
    radius = bbox.Diagonal.Length / 2
    pt = ptc - vect * radius
    pln = rg.Plane(pt, vect)
    return pln

def ray_shoot(ray):
    #-/Normal routine, if not valid, will be passed/-
    count = 0
    while ray.is_valid() and count < 10:
        [pt_hit, Idcs_face] = ray.forward(MESH)
        ray.reflect(MESH, pt_hit, Idcs_face)
        count += 1

def add_to_dict(dict, key, area, portion):
    if key in dict.keys():
        dict[key]['count'] += 1
    else:
        dict[key] = {'count': 1, 'area': area, 'portion': portion}
    return dict

#----------///Main///----------
def Main(panel):
    if panel.is_sunlit(vect_sun):
        area_lumen = panel.calc_area_lumen(vect_sun)
        Rays = []
        Rays_save = []
        Pool_refract = []
        
        #-/The original rays for reflections/-
        Pts = panel.get_Pts()
        idx = panel.get_idx()
        for pt in Pts:
            #-/Declare a new ray/-
            ray = Ray(idx, None, pt, vect_sun, trans_sun, area_lumen, 1.0)
            #-/1st round forward & reflect for sunlit check/-
            ray.initiate(panel, MESH)
            #-/Normal routine/-
            ray_shoot(ray)
            Pool_refract.extend(ray.get_pool())
            Rays_save.append(ray.get_plc())
            Checks.append(ray.get_plc())
            Lst_check = ray.get_idx()
            for idx_check in Lst_check:
                if idx_check in Idcs_termin:
                    Rays.append(ray.get_plc())
                    break
        
        #-/New rays of refractions/-
        for idx_ray, Lst_recipe in enumerate(Pool_refract):
            #-/Declare a new ray/-
            pt = Lst_recipe[0]
            vect_ray = Lst_recipe[1]
            trans_ray = rg.Transform.Translation(vect_ray * TOL)
            portion = Lst_recipe[2]
            Idcs = Lst_recipe[3]
            ray = Ray(idx, Idcs, pt, vect_ray, trans_ray, area_lumen, portion)
            #-/Normal routine/-
            ray_shoot(ray)
            Checks.append(ray.get_plc())
            Lst_check = ray.get_idx()
            for idx_check in Lst_check:
                if idx_check in Idcs_termin:
                    Rays.append(ray.get_plc())
                    Rays.append(Rays_save[idx_ray])
                    break
    else:
        Rays = None
    return Rays

if run_it:
    #---/Get the system accuracy (normally 0.001)/---
    TOL = sc.doc.ModelAbsoluteTolerance
    Checks = []
    
    #---/Set the sun related inputs/---
    vect_sun = recipe.sunvect
    pln_sun = get_sun_pln(scene.get_mesh(), vect_sun) #Solar plane
    trans_sun = rg.Transform.ProjectAlong(pln_sun, vect_sun)
    
    #---/initialize this run/---
    MESH = scene.get_mesh()
    for panel in scene.get_Panels():
        panel.refresh()
    Panels = []
    for idx_panel in Idcs_shoot:
        panel = scene.get_panel(idx_panel)
        Panels.append(panel)
    
    #---/Proceed Ray-Tracing in parallel/---
    Rays = ghpythonlib.parallel.run(Main, Panels, True)
# ---------- end python_22 ----------
python_23 = GhPythonScript(mesh=python_18.mesh, Colors=gradient_2)  # -> mesh; inputs mesh: Mesh, Colors: list of Color; same code as python_20
python_24 = GhPythonScript(pt=pt_2, normal=line_3)  # -> pln; inputs pt: Point3d, normal: Vector3d, dirct: Vector3d
# ---------- python_24: Python ----------
"""Generate a plane based on Z-axis and X or Y-axis.
    Inputs:
        pt: The plane original point
        normal: The plane normal vector
        dirct: The plane rotation reference vector
        hint: The hint string for choosing x or y axis when constructing plane
    Output:
        pln: The desired pln"""

def rotate_pln(pln, vect_ref, hint):
    if hint and hint.lower() == 'y':
        vect_self = pln.YAxis
    else:
        vect_self = pln.XAxis
    ang = rg.Vector3d.VectorAngle(vect_self, vect_ref, pln)
    pln.Rotate(ang, pln.Normal, pln.Origin)
    return pln

import Rhino.Geometry as rg
if pt and normal and dirct:
    pln = rg.Plane(pt, normal)
    pln = rotate_pln(pln, dirct, hint)
# ---------- end python_24 ----------
swatch = ColourSwatch(SwatchColor=RGB(0, 0, 0))
material = CreateMaterial(
    Diffuse=ColourSwatch(SwatchColor=RGB(184, 189, 40)),
    Specular=RGB(255, 255, 255),
    Emission=RGB(0, 0, 0),
    Transparency=0,
    Shine=0)
python_25 = GhPythonScript(mesh=python_23, pack=python_18.pack_remove, bool=falsestart_9)  # -> mesh_out; inputs mesh: Mesh, bool: Boolean
# ---------- python_25: Python ----------
__author__ = "ccy"
__version__ = "2022.08.04"

import Rhino.Geometry as rg
import ghpythonlib.components as ghc

if bool:
    mesh_out = mesh.Duplicate()
    mesh_out.Faces.DeleteFaces(pack.get(), True)
# ---------- end python_25 ----------
python_26 = GhPythonScript(mesh=python_17.mesh, Colors=gradient_3)  # -> mesh; inputs mesh: Mesh, Colors: list of Color; same code as python_20
preview = CustomPreview(Geometry=python_22.Rays, Material=material)
tag = TextTag3D(Location=python_17.Value_Plns, Text=python_17.Value_Txts, Size="0.75", Colour=swatch, Justification=4)
tag_2 = TextTag3D(Location=python_17.Top_Pln, Text="Irradiance (W/m^2)", Size="0.75", Colour=swatch, Justification=5)
tag_3 = TextTag3D(Location=python_17.Bot_Pln, Text=python_21, Size="0.75", Colour=swatch, Justification=5)
tag_4 = TextTag3D(Location=python_24, Size="0.75", Colour=swatch, Justification=1)
